# Grasshopper definition loadJSON.gh (Grasshopper 1.0.7)
# plug-ins: ShapeDiverForGrasshopper

path = FilePath("C:\Users\James\Downloads\dataObject.json")
file = ReadFile(File=path, PerLineParse=False)
parsejson = ParseJSON(JSON=file)
accessjson = AccessJSON(Object=parsejson, AddressString="geometry")
accessjson_2 = AccessJSON(Object=accessjson, AddressString="coordinates")
accessjson_3 = AccessJSON(Object=accessjson, AddressString="type")
expression = Expression(x=accessjson_3, Expression="x=\"Polygon\"")
item = ListItem(List=accessjson_2, Index=0, Wrap=True)  # -> Item, Item1
pt = ConstructPoint(XCoordinate=item.Item, YCoordinate=item.Item1, ZCoordinate=0)
pline = PolyLine(Vertices=flatten(pt), Closed=expression)
